# Grasshopper definition curve2list.gh (Grasshopper 1.0.7)

crv = Curve(<curve referenced from the Rhino model>)
divide = DivideCurve(Curve=crv, Count=Slider(24, range=1..100), Kinks=False)  # -> Points, Tangents, Parameters
panel = Panel(divide.Points)
